# Grasshopper definition exportJS.gh (Grasshopper 0.9.76)
# plug-ins: GENERATOR, LunchBox

mytparam = Slider(1, range=1..5)
addition = Addition(A=mytparam, B=-0.5)
mobius = MobiusSurface(
    UDivisions=100,
    VDivisions=100,
    RParameter=4,
    TParameter=addition,
    Scale=5,
    Domain1=Domain(-3.141592654, 3.141592654),
    Domain2=Domain(-1, 1))  # disabled
Z = UnitZ(Factor=0.3)
myoutputextrude = Extrude(Base=mobius, Direction=Z)

index = Panel("""R
H
O""")
number = Panel("""6
6
6""")
value = Panel("""1
1
1""")
initialgene = InitializeGenerator(Index=index, Number=number, Value=value, Reset=True)  # -> Output, Output_2, Output_3
panel = Panel(initialgene.Output_3)
panel_2 = Panel(initialgene.Output_2)

item = ListItem(List=panel_2, Index=1, Wrap=True)
item_2 = ListItem(List=panel_2, Index=2, Wrap=True)
item_3 = ListItem(List=panel_2, Index=0, Wrap=True)

radiusrange = Range(Domain=Domain(10, 15), Steps=Slider(5, range=5..50))
offsetrange = Range(Domain=Domain(1, 4), Steps=Slider(5, range=5..50))
item_4 = ListItem(List=radiusrange, Index=item_3, Wrap=True)
item_5 = ListItem(List=offsetrange, Index=item_2, Wrap=True)
offsetdist = Number(item_5)
radius = Number(item_4)

centerimage = BooleanToggle(True)
preset = Panel("""3
3
3""")
randomize = Panel("""True
True
True""")
backgroundcolor = ColourSwatch(SwatchColor=RGB(0, 0, 0))
folder = Panel("DATA")
extension = Panel("jpg")
directory = Panel("C:\Users\ptr\Assignments\whiteRoom\deployment\peayad.github.io\3js\04")
slider = Panel(index)
timer = Timer(TimerInterval=1, Target=activegene)  # disabled
switch = BooleanToggle(True)
activegene = ActivateGenerator(
    Slider=slider,
    Index=slider,
    Number=number,
    Preset=preset,
    Randomize=randomize,
    BackgroundColor=backgroundcolor,
    CenterImage=centerimage,
    Folder=folder,
    Extension=extension,
    Switch=switch)
name = Panel(initialgene.Output)

horizontalsections = Slider(9, range=3..9)
offsetdist_2 = Slider(4, range=1..4)
thickness = Slider(0.6, range=0.3..1.3)
radius_2 = Slider(15, range=10..15)
horizontalsections_2 = Number(expr("x+3", item))
radius_3 = Number(radius)
offsetdist_3 = Number(offsetdist)
thickness_2 = Number(thickness)

radius_4 = Number(radius_3)
pt = ConstructPoint(XCoordinate=0, YCoordinate=0, ZCoordinate=expr("x-0.5", radius_4))
pt_2 = ConstructPoint(XCoordinate=0, YCoordinate=0, ZCoordinate=expr("-(x-0.5)", radius_4))
sph = Sphere(Base=PlaneXY(0, 0, 0), Radius=radius_4)
horizontalsections_3 = Number(horizontalsections_2)
ln = Line(StartPoint=pt, EndPoint=pt_2)
pframes = PerpFrames(Curve=ln, Count=horizontalsections_3, Align=True)  # -> Frames, Parameters
sec = BrepPlane(Brep=sph, Plane=flatten(pframes.Frames))  # -> Curves, Points
offsetdist_4 = Number(offsetdist_3)
offset = Offset(Curve=flatten(sec.Curves), Distance=expr("-x", offsetdist_4), Plane=PlaneXY(0, 0, 0), Corners=1)
boundary = BoundarySurfaces(Edges=[sec.Curves, offset])
thickness_3 = Number(thickness_2)
Z_2 = UnitZ(Factor=thickness_3)
extr = Extrude(Base=boundary, Direction=Z_2)

# ---- group: To be Baked
finalbrep = Brep(extr)

# ----
panel_3 = Panel(offsetrange)
panel_4 = Panel(activegene)
transparentbackground = BooleanToggle(False)
width = Panel("400")
height = Panel("400")
scale = Panel("1")
drawgrid = BooleanToggle(False)
drawworldaxes = BooleanToggle(False)
drawcplaneaxes = BooleanToggle(False)
finalgene = FinalizeGenerator(
    Directory=directory,
    Folder=folder,
    Name=name,
    Extension=extension,
    Width=width,
    Height=height,
    Scale=scale,
    DrawGrid=drawgrid,
    DrawWorldAxes=drawworldaxes,
    DrawCPlaneAxes=drawcplaneaxes,
    TransparentBackground=transparentbackground,
    Pause=True)

# ---- group: BrepMaterial
finalbrep_2 = Brep(extr)
preview = CustomPreview(Geometry=finalbrep_2, Shader=ColourSwatch(SwatchColor=RGB(255, 255, 255)))
preview_2 = CustomPreview(Geometry=finalbrep_2, Shader=ColourSwatch(SwatchColor=RGB(191, 191, 191)))
