# Grasshopper definition exportSTL.gh (Grasshopper 0.9.76)
# plug-ins: Python Interpreter, LunchBox, TT Toolbox

steps = Slider(6, range=3..20)

R = Slider(1, range=1..7)
H = Slider(1, range=1..7)
O = Slider(1, range=1..7)

# ---- group: original params
horizontalsections = Slider(3, range=3..9)
offsetdist = Slider(4, range=1..4)
thickness = Slider(0.6, range=0.3..1.3)
radius = Slider(15, range=10..15)

# ----
range = Range(Domain=Domain(10, 15), Steps=steps)
range_2 = Range(Domain=Domain(10, 15), Steps=steps)
item = ListItem(List=range, Index=expr("x-1", O), Wrap=True)
item_2 = ListItem(List=range_2, Index=expr("x-1", R), Wrap=True)
panel = Panel(item_2)
horizontalsections_2 = Number(expr("x+2", H))
offsetdist_2 = Number(item)
radius_2 = Number(item_2)
thickness_2 = Number(thickness)

# ---- group: modeling
radius_3 = Number(radius_2)
pt = ConstructPoint(XCoordinate=0, YCoordinate=0, ZCoordinate=expr("x-0.5", radius_3))
pt_2 = ConstructPoint(XCoordinate=0, YCoordinate=0, ZCoordinate=expr("-(x-0.5)", radius_3))
sph = Sphere(Base=PlaneXY(0, 0, 0), Radius=radius_3)
horizontalsections_3 = Number(horizontalsections_2)
ln = Line(StartPoint=pt, EndPoint=pt_2)
pframes = PerpFrames(Curve=ln, Count=horizontalsections_3, Align=True)  # -> Frames, Parameters
sec = BrepPlane(Brep=sph, Plane=flatten(pframes.Frames))  # -> Curves, Points
offsetdist_3 = Number(offsetdist_2)
offset = Offset(Curve=flatten(sec.Curves), Distance=expr("-x", offsetdist_3), Plane=PlaneXY(0, 0, 0), Corners=1)
boundary = BoundarySurfaces(Edges=[sec.Curves, offset])
thickness_3 = Number(thickness_2)
Z = UnitZ(Factor=thickness_3)
extr = Extrude(Base=boundary, Direction=Z)

# ---- group: To be Baked
finalbrep = Brep(extr)

# ---- group: filename and delete previous export
panel_2 = Panel("""R
H
O""")
panel_3 = Panel([R, H, O])
python = PythonScript(tags=panel_2, values=panel_3)  # -> out, a; inputs tags: list, values: list of Int32
# ---------- python: Python ----------
import rhinoscriptsyntax as rs

rs.Command("_selall")
rs.Command("_delete")

myStr = []
for x in range(len(tags)):
    myStr.append( tags[x] + str(int(values[x])) )

a = '_'.join(myStr) + '.stl'
# ---------- end python ----------
panel_4 = Panel(python.a)

# ---- group: exporting params
panel_5 = Panel("C:\Users\ptr\Assignments\whiteRoom\deployment\peayad.github.io\3js\04b\STL")
toggle = BooleanToggle(False)
brep = Brep(finalbrep)
save = ObjectSave(
    BakeToggle=toggle,
    FileDirectory=panel_5,
    FileName=panel_4,
    GeometryObjects=brep,
    Layer="GH_Export",
    ObjectName=panel_4,
    ObjectColor=RGB(255, 255, 255),
    LayerColor=RGB(255, 255, 255))
bt = BruteForce(NumberSlider=[R, H, O], RunTheScript=toggle)
