# Grasshopper definition exportSTL.gh (Grasshopper 0.9.76)
# plug-ins: Python Interpreter, LunchBox, TT Toolbox

steps = Slider(5, range=3..20)

L = Slider(1, range=1..6)
H = Slider(1, range=1..6)
V = Slider(1, range=1..6)

range = Range(Domain=Domain(30, 50), Steps=steps)
item = ListItem(List=range, Index=expr("x-1", L), Wrap=True)
panel = Panel(range)

# ---- group: modelingController
numofhsections = Number(expr("x+4", H))
numofvsections = Number(expr("x+4", V))
length = Number(item)

# ---- group: modeling algorithm
radius = Slider(15, range=0..100)
width_of_section = Slider(5, range=0..10)
numofhsections_2 = Number(numofhsections)
numofvsections_2 = Number(numofvsections)
length_2 = Number(length)
cir = Circle(Plane=PlaneXY(0, 0, 0), Radius=radius)
range_2 = Range(Domain=length_2, Steps=numofhsections_2)
xy = XYPlane(Origin=Point(0, 0, 0))
X = UnitX(Factor=1)
range_3 = Range(Domain=Domain(0, 1), Steps=numofhsections_2)
Z = UnitZ(Factor=range_2)
move = Move(Geometry=cir, Motion=Z)  # -> Geometry, Transform
graph = GraphMapper(range_3, x0=0, x1=1, y0=0, y1=1, container_name="Sine", Equation_px=[0.5034781098, 1], Equation_py=[1, 0.198260963])
line = LineSDL(Start=xy, Direction=X, Length=expr("x*2", Slider(50, range=0..100)))
area = Area(Geometry=move.Geometry)  # -> Area, Centroid
dom = ConstructDomain(DomainStart=0, DomainEnd=expr("2*pi", 1))
scale = Scale(Geometry=move.Geometry, Center=area.Centroid, Factor=graph)  # -> Geometry, Transform
range_4 = Range(Domain=dom, Steps=numofvsections_2)
offset = Offset(Curve=scale.Geometry, Distance=width_of_section, Plane=PlaneXY(0, 0, 0), Corners=1)
rotate = Rotate(Geometry=line, Angle=range_4, Plane=PlaneXY(0, 0, 0))  # -> Geometry, Transform
Z_2 = UnitZ(Factor=-1)
Z_3 = UnitZ(Factor=expr("x+10", length_2))
move_2 = Move(Geometry=rotate.Geometry, Motion=Z_2)  # -> Geometry, Transform
boundary = BoundarySurfaces(Edges=flatten([offset, scale.Geometry]))
extr = Extrude(Base=move_2.Geometry, Direction=Z_3)
bbx = BrepBrep(BrepA=extr, BrepB=graft(boundary))  # -> Curves, Points
sectionsthickness = Slider(0.3, range=0..1)
pshift = ShiftPaths(Data=bbx.Curves, Offset=-1)
number_slider = Slider(0, range=0..100)
flip = FlipMatrix(Data=pshift)
cull_i = CullIndex(List=flip, Indices=number_slider, Wrap=True)
cull_i_2 = CullIndex(List=boundary, Indices=number_slider, Wrap=True)
dom_2 = ConstructDomain(DomainStart=expr("-x/2", sectionsthickness), DomainEnd=expr("x/2", sectionsthickness))
lng = ListLength(List=cull_i)
lng_2 = ListLength(List=cull_i_2)
cull_i_3 = CullIndex(List=cull_i, Indices=expr("x-1", lng), Wrap=True)
end = EndPoints(Curve=cull_i_3)  # -> Start, End
vec2pt = Vector2Pt(PointA=end.End, PointB=end.Start, Unitize=False)  # -> Vector, Length
pl = PlaneNormal(Origin=end.Start, ZAxis=vec2pt.Vector)
rectangle = Rectangle(Plane=pl, XSize=dom_2, YSize=dom_2, Radius=0)  # -> Rectangle, Length
cull_i_4 = CullIndex(List=cull_i_2, Indices=expr("x-1", lng_2), Wrap=True)
curvepoint = PointOnCurve(cull_i_3, parameter=0.5)
extrcrv = ExtrudeAlong(Base=rectangle.Rectangle, Curve=cull_i_3)
cap = CapHoles(Brep=extrcrv)
vec2pt_2 = Vector2Pt(PointA=curvepoint, PointB=end.Start, Unitize=False)  # -> Vector, Length
loft = Loft(Curves=flip, Options={Adjust=False, Closed=False, LoftEnds=0, LoftSimp=0, LoftType=0, Rebuild=10, Refit=0.01})
deplane = DeconstructPlane(Plane=loft)  # -> Origin, XAxis, YAxis, ZAxis
Z_4 = UnitZ(Factor=sectionsthickness)
amp = Amplitude(Vector=deplane.ZAxis, Amplitude=sectionsthickness)
move_3 = Move(Geometry=loft, Motion=expr("-x/2", amp))  # -> Geometry, Transform
move_4 = Move(Geometry=cull_i_4, Motion=expr("-x/2", Z_4))  # -> Geometry, Transform
move_5 = Move(Geometry=cap, Motion=expr("-x", vec2pt_2.Vector))  # -> Geometry, Transform
extr_2 = Extrude(Base=move_4.Geometry, Direction=Z_4)
move_6 = Move(Geometry=cap, Motion=vec2pt_2.Vector)  # -> Geometry, Transform
extr_3 = Extrude(Base=move_3.Geometry, Direction=amp)
sdiff = SolidDifference(BrepsA=extr_2, BrepsB=flatten(move_6.Geometry))
sdiff_2 = SolidDifference(BrepsA=extr_3, BrepsB=move_5.Geometry)
cull_i_5 = CullIndex(List=flatten(sdiff_2), Indices=0, Wrap=True)
flatten = FlattenTree(Tree=cull_i_5, Path="{0}")
brep = Brep(flatten([flatten, sdiff]))

# ----
finalbrep = Brep(brep)

# ---- group: filename and delete previous export
panel_2 = Panel("""L
H
V""")
panel_3 = Panel([L, H, V])
python = PythonScript(tags=panel_2, values=panel_3)  # -> out, a; inputs tags: list, values: list of Int32
# ---------- python: Python ----------
import rhinoscriptsyntax as rs

rs.Command("_selall")
rs.Command("_delete")

myStr = []
for x in range(len(tags)):
    myStr.append( tags[x] + str(int(values[x])) )

a = '_'.join(myStr) + '.stl'
# ---------- end python ----------
panel_4 = Panel(python.a)

# ---- group: exporting params
panel_5 = Panel("C:\Users\ptr\Assignments\whiteRoom\deployment\peayad.github.io\3js\04c\STL")
toggle = BooleanToggle(False)
save = ObjectSave(
    BakeToggle=toggle,
    FileDirectory=panel_5,
    FileName=panel_4,
    GeometryObjects=finalbrep,
    Layer="GH_Export",
    ObjectName=panel_4,
    ObjectColor=RGB(255, 255, 255),
    LayerColor=RGB(255, 255, 255))
bt = BruteForce(NumberSlider=[L, H, V], RunTheScript=toggle)
