# Grasshopper definition create_JSON.gh (Grasshopper 0.9.76)
# plug-ins: Python Interpreter

number_01 = Panel("{\"metadata\":{\"formatVersion\":3.2,\"type\":\"scene\"},\"urlBaseType\":\"relativeToHTML\",\"objects\":{\"group\": {\"position\":[0,0,0],\"rotation\":[0,0,0],\"scale\":[1,1,1],\"visible\": true,\"children\":{")
number_03 = Panel("\"mainCamera\":{\"type\":\"PerspectiveCamera\",\"fov\": 50,\"aspect\":1.33333,\"near\":1,\"far\":5000,\"position\":[0,0,250],\"target\":[0,0,0]},\"light1\":{\"type\":\"PointLight\",\"position\":[0,200,0],\"color\":16777215,\"intensity\":1},\"light2\":{\"type\":\"PointLight\",\"position\":[100,200,100],\"color\":16777215,\"intensity\":1},\"light3\":{\"type\":\"PointLight\",\"position\":[-100, -200, -100],\"color\":16777215,\"intensity\":1}}}},\"geometries\":{")
number_05 = Panel("},\"materials\":{\"myMaterial\":{\"type\":\"MeshPhongMaterial\",\"parameters\":{\"color\":1401481,\"emissive\":468276,\"side\":\"double\",\"shading\":\"flat\"}}},\"defaults\":{\"bgcolor\":[0,0,0],\"bgalpha\":1,\"camera\":\"mainCamera\"}}")
number_01_2 = Panel("{\"metadata\":{\"formatVersion\":3.2,\"type\":\"scene\"},\"urlBaseType\":\"relativeToHTML\",\"objects\":{\"group\": {\"position\":[0,0,0],\"rotation\":[0,0,0],\"scale\":[1,1,1],\"visible\": true,\"children\":{")
number_03_2 = Panel("\"mainCamera\":{\"type\":\"PerspectiveCamera\",\"fov\": 50,\"aspect\":1.33333,\"near\":1,\"far\":5000,\"position\":[0,0,250],\"target\":[0,0,0]},\"light1\":{\"type\":\"PointLight\",\"position\":[0,200,0],\"color\":16777215,\"intensity\":1},\"light2\":{\"type\":\"PointLight\",\"position\":[100,200,100],\"color\":16777215,\"intensity\":1},\"light3\":{\"type\":\"PointLight\",\"position\":[-100, -200, -100],\"color\":16777215,\"intensity\":1}}}},\"geometries\":{")
number_05_2 = Panel("},\"materials\":{\"myMaterial\":{\"type\":\"MeshPhongMaterial\",\"parameters\":{\"color\":1401481,\"emissive\":468276,\"side\":\"double\",\"shading\":\"flat\"}}},\"defaults\":{\"bgcolor\":[0,0,0],\"bgalpha\":1,\"camera\":\"mainCamera\"}}")
python = PythonScript(x=number_01, y=number_03, z=number_05)  # -> out, a
# ---------- python: Python ----------
geometryText = '"%s":{"geometry":"%s","material":"myMaterial","position":[0,0,0],"rotation":[0,0,0],"scale":[1,1,1],"visible":false}'
urlText = '"%s":{"type":"ctm","url":"models"/%s.ctm}'

geometryOut = []
urlOut = []

for L in range(1,7):
    for H in range(1,7):
        for V in range(1,7):
            tempName = 'L%s_H%s_V%s' %(L,H,V)
            geometryOut.append( geometryText %(tempName,tempName) )
            urlOut.append( urlText %(tempName,tempName) )

geometryOut = ','.join(geometryOut)
urlOut = ','.join(urlOut)

a = ''.join([x,geometryOut,y,urlOut,z])
# ---------- end python ----------
number_04 = Panel("\"L1_H1_V1\":{\"type\":\"ctm\",\"url\":\"models/L1_H1_V1.ctm\"}")
number_02 = Panel("\"L1_H1_V1\":{\"geometry\": \"L1_H1_V1\",\"material\": \"myMaterial\",\"position\": [0, 0, 0],\"rotation\": [0, 0, 0],\"scale\": [1, 1, 1],\"visible\": true},")
_02_geometry = Panel(python.a)
mereged = Panel([number_01_2, number_02, number_03_2, number_04, number_05_2])
streamed_to_folder = Panel(mereged)
